# Grasshopper definition kuka_prc_test.ghx (Grasshopper 1.0.7)
# plug-ins: KUKA|prc - parametric robot control

number_slider = Slider(500, range=0..1000)
pt = ConstructPoint(XCoordinate=number_slider, YCoordinate=0, ZCoordinate=number_slider)
X = UnitX(Factor=1)
Y = UnitY(Factor=1)
pl = ConstructPlane(Origin=pt, XAxis=expr("-x", X), YAxis=Y)
lin_move = LINearMovementKUKAPrc(TargetAsPlane=pl, extaxenabled=False, interpolation="C_DIS")
kr6_10_r1100_2 = AgilusKR610R11002Robot(infiniterot=False)
panel = Panel("""&ACCESS RVP
&REL 1
&PARAM TEMPLATE = C:\KRC\Roboter\Template\vorgabe
&PARAM EDITMASK = *
DEF test ( )


;FOLD INI
;FOLD BASISTECH INI
GLOBAL INTERRUPT DECL 3 WHEN $STOPMESS==TRUE DO IR_STOPM ( )
INTERRUPT ON 3
BAS (#INITMOV,0 )
;ENDFOLD (BASISTECH INI)
;ENDFOLD (INI)

;FOLD STARTPOSITION - BASE IS 0, TOOL IS 0, SPEED IS 15%, POSITION IS A1 0,A2 -90,A3 90,A4 0,A5 0,A6 0,E1 0,E2 0,E3 0,E4 0
$BWDSTART = FALSE
PDAT_ACT = {VEL 15,ACC 100,APO_DIST 50}
FDAT_ACT = {TOOL_NO 0,BASE_NO 0,IPO_FRAME #BASE}
BAS (#PTP_PARAMS,15)
PTP  {A1 0,A2 -90,A3 90,A4 0,A5 0,A6 0,E1 0,E2 0,E3 0,E4 0}
;ENDFOLD

;FOLD LIN SPEED IS 0.25 m/sec, INTERPOLATION SETTINGS IN FOLD
$VEL.CP=0.25
$ADVANCE=3
;ENDFOLD

PTP {X 500, Y 0, Z 500, A -180, B 0, C 180, E1 0, E2 0, E3 0, E4 0, S 'B 010'} C_PTP
LIN {X 500, Y 0, Z 500, A -180, B 0, C 180, E1 0, E2 0, E3 0, E4 0} C_DIS
HALT

END""")
kuka_prc = KUKAPrcCORE(
    SimulationSlider=Slider(0, range=0..1),
    KUKAPrcCommands=lin_move,
    Robot=kr6_10_r1100_2,
    SaveToggle=Toggle(True),
    Filename="test",
    PRC_BaseExpose=False,
    PRC_SaveNameExpose=True,
    PRCsettings="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")  # -> RobotGeometry, AnalysisOutput
python = GhPythonScript(run=Toggle(False))  # -> out, a; inputs run: Boolean
# ---------- python: Python ----------
import socket
import traceback

def read(HOST='172.31.1.147', PORT=30003):
    """
    Method that opens a TCP socket to the robot, receives data from the robot server and then closes socket

    Returns:
        data: Data broadcast by the robot. In bytes
    """

    s = socket.socket(socket.AF_INET, socket.SOCK_STREAM)
    s.settimeout(1)
    
    try:
        s.connect((HOST, PORT))
        print "connected"
    except:
        traceback.print_exc()
        print "Cannot connect to ",HOST,PORT
    
#    s.settimeout(None)
#    data = s.recv(1024)
    s.close()
    return data

if run:
    read()
# ---------- end python ----------
sender = GhPythonScript(script=panel, execute=Toggle(False))  # -> out, a
# ---------- sender: Python ----------
__author__  = 'petrus'
__version__ = '2021.10.04'


import socket                   # module for network comunication

robot_ip = '172.31.1.147'      # numerical label assigned to the UR robotic arm


def send_script(ur_ip, script):
#    socket.create_connection(
    s = socket.create_connection(ur_ip) 
    #creates a connection between this computer and the robot. This computer must have an ip number that is the same except for the last two numbers.
    s.send(script)
    print ("Script sent to %s on port %i" % (ur_ip))
    s.close()


if execute:
    
    send_script(robot_ip,script)
# ---------- end sender ----------
